# Grasshopper definition BlockDesignJ.gh (Grasshopper 1.0.7)
# plug-ins: HDMolaGH

# ---- group: input
number_slider = Slider(278, range=0..1000)
number_slider_2 = Slider(88, range=0..100)

# ----
quad = MolaQuad(
    X1=0,
    Y1=0,
    Z1=0,
    X2=number_slider,
    Y2=0,
    Z2=0,
    X3=number_slider,
    Y3=number_slider_2,
    Z3=0,
    X4=0,
    Y4=number_slider_2,
    Z4=0)
grid = SubdivideGrid(MolaMesh=quad, U=Slider(5, range=0..10), V=1, Iteration=1)
analyze_mesh = AnalyzeMolaMesh(MolaMesh=grid)  # -> VerticeCount, FaceCount
min = Minimum(A=Slider(20, range=0..100), B=Slider(20, range=0..100))
face_modulo = AnalyzeFaceModulo(MolaMesh=grid, Modulo=analyze_mesh.FaceCount, N=0)
number_slider_3 = Slider(23, range=0..100)
number_slider_4 = Slider(1, range=0..10)
split = MeshSplit(MolaMesh=grid, BooleanList=face_modulo)  # -> MolaMesh1, MolaMesh2
offset = SubdivideOffset(MolaMesh=grid, Offset=Slider(-5, range=-10..-5), Iteration=1)
linear_split_border = SubdivideLinearSplitBorder(MolaMesh=split.MolaMesh1, BorderWidth1=number_slider_3, BorderWidth2=number_slider_3, SplitDirection=1, Iteration=1)
to_rhino = MolaToRhino(MolaMesh=split.MolaMesh2, WithColor=True)
number_slider_5 = Slider(50, range=0..100)
to_rhino_2 = MolaToRhino(MolaMesh=linear_split_border, WithColor=True)
face_modulo_2 = AnalyzeFaceModulo(MolaMesh=offset, Modulo=5, N=4)
split_2 = MeshSplit(MolaMesh=offset, BooleanList=face_modulo_2)  # -> MolaMesh1, MolaMesh2
analyze_mesh_2 = AnalyzeMolaMesh(MolaMesh=split_2.MolaMesh1)  # -> VerticeCount, FaceCount

# ---- group: road
color = ColorMesh(
    MolaMesh=split_2.MolaMesh2,
    Mode=0,
    SingleColor=ColourSwatch(SwatchColor=RGB(47, 48, 84)),
    ColorList=RGB(255, 254, 254),
    ValueList=0)
to_rhino_3 = MolaToRhino(MolaMesh=color, WithColor=True)

# ----
random = Random(Range=Domain(0, 1), Number=analyze_mesh_2.FaceCount, Seed=Slider(3, range=0..10))
larger = LargerThan(FirstNumber=random, SecondNumber=0.8)  # -> LargerThan, OrEqualTo
split_3 = MeshSplit(MolaMesh=split_2.MolaMesh1, BooleanList=larger.OrEqualTo)  # -> MolaMesh1, MolaMesh2

# ---- group: park
color_2 = ColorMesh(
    MolaMesh=split_3.MolaMesh1,
    Mode=0,
    SingleColor=ColourSwatch(SwatchColor=RGB(9, 222, 37)),
    ColorList=RGB(255, 254, 254),
    ValueList=0)
to_rhino_4 = MolaToRhino(MolaMesh=color_2, WithColor=True)

# ----
number_slider_6 = Slider(0.6, range=0..1)
number_slider_7 = Slider(0.4, range=0..1)
face_index = AnalyzeFaceIndex(MolaMesh=split_3.MolaMesh2)
mod = Modulus(A=face_index, B=2)
split_4 = MeshSplit(MolaMesh=split_3.MolaMesh2, BooleanList=mod)  # -> MolaMesh1, MolaMesh2
face_location = AnalyzeFaceLocation(MolaMesh=split_4.MolaMesh2)
pdecon = Deconstruct(Point=face_location)  # -> XComponent, YComponent, ZComponent
item = ListItem(List=pdecon.XComponent, Index=0, Wrap=True)
item_2 = ListItem(List=pdecon.YComponent, Index=0, Wrap=True)
circle = MolaCircle(X=item, Y=item_2, Z=0, Radius=min, Segments=6)
face_modulo_3 = AnalyzeFaceModulo(MolaMesh=circle, Modulo=6, N=0)
split_5 = MeshSplit(MolaMesh=circle, BooleanList=face_modulo_3)  # -> MolaMesh1, MolaMesh2
extrude = SubdivideExtrude(MolaMesh=split_5.MolaMesh1, Height=Slider(68, range=0..100), Cap=True, Iteration=1)
face_area = AnalyzeFaceArea(MolaMesh=extrude)
larger_2 = LargerThan(FirstNumber=face_area, SecondNumber=300)  # -> LargerThan, OrEqualTo
split_6 = MeshSplit(MolaMesh=extrude, BooleanList=larger_2.LargerThan)  # -> MolaMesh1, MolaMesh2
relative = SubdivideRelative(
    MolaMesh=split_6.MolaMesh1,
    StartDiriection=1,
    MinSplit1=Slider(0.4, range=0..1),
    MaxSplit1=Slider(0.8, range=0..1),
    MinSplit2=Slider(0.1, range=0..1),
    MaxSplit2=Slider(0.5, range=0..1),
    Iteration=1)
relative_2 = SubdivideRelative(
    MolaMesh=relative,
    StartDiriection=0,
    MinSplit1=number_slider_7,
    MaxSplit1=number_slider_7,
    MinSplit2=number_slider_6,
    MaxSplit2=number_slider_6,
    Iteration=1)
pt = Point(face_location)
neg = Negative(Value=Slider(2, range=0..10))
merge = Merge(Data1=Toggle(True), Data2=Toggle(False), Data3=Toggle(False), Data4=Toggle(False))
split_7 = MeshSplit(MolaMesh=split_4.MolaMesh1, BooleanList=merge)  # -> MolaMesh1, MolaMesh2

number_slider_8 = Slider(-30, range=-100..-30)
number_slider_9 = Slider(30, range=0..100)
quad_2 = MolaQuad(
    X1=number_slider_8,
    Y1=number_slider_8,
    Z1=0,
    X2=number_slider_9,
    Y2=number_slider_8,
    Z2=0,
    X3=number_slider_9,
    Y3=number_slider_9,
    Z3=0,
    X4=number_slider_8,
    Y4=number_slider_9,
    Z4=0)
extrude_2 = SubdivideExtrude(MolaMesh=split_7.MolaMesh1, Height=Slider(60, range=0..100), Cap=True, Iteration=1)
extrude_tapered = SubdivideExtrudeTapered(MolaMesh=extrude_2, Height=0, Fraction=Slider(0.042, range=0..1), Cap=False, Iteration=1)
offset_face = SubdivideOffsetFace(MolaMesh=extrude_tapered, Offset=Slider(5, range=0..10), CloseBorders=True, Iteration=1)
face_modulo_4 = AnalyzeFaceModulo(MolaMesh=extrude_2, Modulo=5, N=Slider(4, range=0..10))
split_8 = MeshSplit(MolaMesh=extrude_2, BooleanList=face_modulo_4)  # -> MolaMesh1, MolaMesh2
extrude_tapered_2 = SubdivideExtrudeTapered(MolaMesh=split_8.MolaMesh1, Height=Slider(-50, range=-100..-50), Fraction=Slider(1, range=0..1), Cap=True, Iteration=1)
grid_2 = SubdivideGrid(MolaMesh=extrude_tapered_2, U=Slider(10, range=0..100), V=Slider(30, range=0..100), Iteration=1)
extrude_tapered_3 = SubdivideExtrudeTapered(MolaMesh=grid_2, Height=1, Fraction=Slider(0.2, range=0..1), Cap=True, Iteration=1)
face_modulo_5 = AnalyzeFaceModulo(MolaMesh=extrude_tapered_3, Modulo=5, N=4)
split_9 = MeshSplit(MolaMesh=extrude_tapered_3, BooleanList=face_modulo_5)  # -> MolaMesh1, MolaMesh2
join = MeshJoin(MolaMeshes=[offset_face, split_8.MolaMesh1, split_9.MolaMesh2])
analyze_mesh_3 = AnalyzeMolaMesh(MolaMesh=split_9.MolaMesh1)  # -> VerticeCount, FaceCount
random_2 = Random(Range=Domain(0, 1), Number=analyze_mesh_3.FaceCount, Seed=2)
larger_3 = LargerThan(FirstNumber=random_2, SecondNumber=0.5)  # -> LargerThan, OrEqualTo
split_10 = MeshSplit(MolaMesh=split_9.MolaMesh1, BooleanList=larger_3.LargerThan)  # -> MolaMesh1, MolaMesh2
color_3 = ColorMesh(
    MolaMesh=join,
    Mode=0,
    SingleColor=ColourSwatch(SwatchColor=RGB(207, 196, 196)),
    ColorList=RGB(255, 255, 255),
    ValueList=0)
color_4 = ColorMesh(
    MolaMesh=split_10.MolaMesh1,
    Mode=0,
    SingleColor=ColourSwatch(SwatchColor=RGB(18, 71, 163)),
    ColorList=RGB(255, 255, 255),
    ValueList=0)
color_5 = ColorMesh(
    MolaMesh=split_10.MolaMesh2,
    Mode=0,
    SingleColor=ColourSwatch(SwatchColor=RGB(255, 174, 0)),
    ColorList=RGB(255, 255, 255),
    ValueList=0)
to_rhino_5 = MolaToRhino(MolaMesh=color_3, WithColor=True)
to_rhino_6 = MolaToRhino(MolaMesh=color_4, WithColor=True)
to_rhino_7 = MolaToRhino(MolaMesh=color_5, WithColor=True)

offset_2 = SubdivideOffset(MolaMesh=relative_2, Offset=neg, Iteration=1)
panel = Panel(face_location)
face_modulo_6 = AnalyzeFaceModulo(MolaMesh=offset_2, Modulo=5, N=4)
split_11 = MeshSplit(MolaMesh=offset_2, BooleanList=face_modulo_6)  # -> MolaMesh1, MolaMesh2
to_rhino_8 = MolaToRhino(MolaMesh=split_7.MolaMesh1, WithColor=True)
extrude_3 = SubdivideExtrude(MolaMesh=split_11.MolaMesh2, Height=Slider(4, range=0..10), Cap=True, Iteration=1)
neg_2 = Negative(Value=Slider(0.2, range=0..1))
split_grid_abs = SubdivideSplitGridAbs(MolaMesh=extrude_3, USize=1, VSize=1, Iteration=1)
extrude_tapered_4 = SubdivideExtrudeTapered(MolaMesh=split_grid_abs, Height=neg_2, Fraction=Slider(0.2, range=0..1), Cap=True, Iteration=1)
face_modulo_7 = AnalyzeFaceModulo(MolaMesh=extrude_tapered_4, Modulo=5, N=4)
split_12 = MeshSplit(MolaMesh=extrude_tapered_4, BooleanList=face_modulo_7)  # -> MolaMesh1, MolaMesh2
color_6 = ColorMesh(
    MolaMesh=split_12.MolaMesh2,
    Mode=0,
    SingleColor=ColourSwatch(SwatchColor=RGB(255, 153, 153)),
    ColorList=RGB(255, 255, 255),
    ValueList=0)
to_rhino_9 = MolaToRhino(MolaMesh=color_6, WithColor=Toggle(True))
color_7 = ColorMesh(
    MolaMesh=split_12.MolaMesh1,
    Mode=0,
    SingleColor=ColourSwatch(SwatchColor=RGB(0, 0, 0)),
    ColorList=RGB(255, 255, 255),
    ValueList=0)
to_rhino_10 = MolaToRhino(MolaMesh=color_7, WithColor=Toggle(True))
